# Grasshopper definition Prototype.gh (Grasshopper 1.0.7)

thickness = Slider(33, range=0..100)
number_of_spokes = Slider(5, range=1..20)
outer_circle_radius = Slider(100, range=0..100)
inner_radius = Slider(21, range=0..100)
outer_width = Slider(22, range=0..100)
spoke_width = Slider(17, range=0..100)
panel = Panel(spoke_width)

# ---- group: Make Outer Arc
subtraction = Subtraction(A=outer_circle_radius, B=outer_width)
expression = Expression(x=spoke_width, y=subtraction, Expression="ASin(x/(2*y))")
expression_2 = Expression(x=spoke_width, y=subtraction, z=number_of_spokes, Expression="((2/z)*Pi)-2*(ASin(x/(2*y)))")
xy_plane = XYPlane(Origin=Point(0, 0, 0))
rotate = Rotate(Geometry=xy_plane, Angle=expression, Plane=PlaneXY(0, 0, 0))  # -> Geometry, Transform
arc = Arc(Plane=rotate.Geometry, Radius=subtraction, Angle=expression_2)  # -> Arc, Length

# ----
panel_2 = Panel(inner_radius)

# ---- group: construct right line
subtraction_2 = Subtraction(A=outer_circle_radius, B=outer_width)
expression_3 = Expression(b=spoke_width, c=[inner_radius, subtraction_2], Expression="sqrt(c^2-(b/2)^2)")
division = Division(A=spoke_width, B="-2")
construct_point = ConstructPoint(XCoordinate=expression_3, YCoordinate=division, ZCoordinate=0)
list_item = ListItem(List=construct_point, Index="0", Wrap=True)  # -> Item, Item1
line = Line(StartPoint=list_item.Item, EndPoint=list_item.Item1)

# ---- group: Make Outer CRC
circle = Circle(Plane=PlaneXY(0, 0, 0), Radius=outer_circle_radius)

# ---- group: Make Inner Arc
expression_4 = Expression(x=spoke_width, y=inner_radius, z=number_of_spokes, Expression="((2/z)*Pi)-2*(ASin(x/(2*y)))")
expression_5 = Expression(x=spoke_width, y=inner_radius, Expression="ASin(x/(2*y))")
xy_plane_2 = XYPlane(Origin=Point(0, 0, 0))
rotate_2 = Rotate(Geometry=xy_plane_2, Angle=expression_5, Plane=PlaneXY(0, 0, 0))  # -> Geometry, Transform
arc_2 = Arc(Plane=rotate_2.Geometry, Radius=inner_radius, Angle=expression_4)  # -> Arc, Length

# ---- group: construct left line
subtraction_3 = Subtraction(A=outer_circle_radius, B=outer_width)
division_2 = Division(A=spoke_width, B="2")

# ----
relay = Relay([inner_radius, subtraction_3])

# ---- group: construct left line (continued)
expression_6 = Expression(b=spoke_width, c=relay, Expression="sqrt(c^2-(b/2)^2)")
construct_point_2 = ConstructPoint(XCoordinate=expression_6, YCoordinate=division_2, ZCoordinate=0)
list_item_2 = ListItem(List=construct_point_2, Index="0", Wrap=True)  # -> Item, Item1
line_2 = Line(StartPoint=list_item_2.Item, EndPoint=list_item_2.Item1)

# ----
panel_3 = Panel(division_2)
panel_4 = Panel(expression_6)
panel_5 = Panel(construct_point_2)

# ---- group: Array Base Lines
expression_7 = Expression(x=number_of_spokes, Expression="2*Pi/x")
series = Series(Start=0, Step=expression_7, Count=number_of_spokes)
graft_tree = GraftTree(Tree=series, IncludeEmptyLists=True, IncludeNullItems=True)
rotate_3 = Rotate(Geometry=[arc_2.Arc, arc.Arc, line_2, line], Angle=graft_tree, Plane=PlaneXY(0, 0, 0))  # -> Geometry, Transform

# ---- group: Join curves
flatten_tree = FlattenTree(Tree=rotate_3.Geometry, Path="{0}")
join_curves = JoinCurves(Curves=flatten_tree, Preserve=False)

# ---- group: Make Top and Bottom srf
flatten_tree_2 = FlattenTree(Tree=[circle, join_curves], Path="{0}")
boundary_surfaces = BoundarySurfaces(Edges=flatten_tree_2)
unit_z = UnitZ(Factor=thickness)
move = Move(Geometry=boundary_surfaces, Motion=unit_z)  # -> Geometry, Transform

# ---- group: Extrude walls
unit_z_2 = UnitZ(Factor=thickness)
extrude = Extrude(Base=[circle, join_curves], Direction=unit_z_2)
