# Grasshopper definition TORQUE.gh (Grasshopper 1.0.7)

outer_race_width_in = Slider(0.561, range=0.001..10)
outer_race_thickness_in = Slider(0.86, range=0.001..10)
finger_indentation_radius_deg = Slider(0.377, range=0..10)
spoke_radial_spacing_deg = Slider(90, range=0..360)
spoke_thickness_in = Slider(0.56, range=0.001..10)
spoke_radii_in = Slider(0.25, range=0..5)
hole_geometry_edge_count = Slider(4, range=3..10)
outer_race_diameter_inch = Slider(4.984, range=0.001..10)
inner_race_radius_in = Slider(0.586, range=0.001..10)
no_of_finger_indentations_in = Slider(14, range=0..30)
hub_diameter_in = Slider(0.7, range=0.001..10)
hub_thickness_in = Slider(0.675, range=0..10)
no_of_spokes = Slider(4, range=1..15)
spoke_width_in = Slider(0.443, range=0.001..10)
hole_diameter_measurement_in = Slider(0.378, range=0.001..10)
hole_taper_length_in = Slider(0.86, range=0.001..10)
hole_taper_angle_deg = Slider(3.6, range=0..90)
fillet_radii_in = Slider(0.1, range=0..1)
mesh_tolerance_distance_in = Slider(0.001, range=1e-05..0.1)
generate_files = Button()
torque = TORQUE(
    outer_race_diameter=outer_race_diameter_inch,
    outer_race_width=outer_race_width_in,
    outer_race_thickness=outer_race_thickness_in,
    inner_race_radius=inner_race_radius_in,
    no_of_finger_indentations=no_of_finger_indentations_in,
    finger_indentation_radius=finger_indentation_radius_deg,
    hub_diameter=hub_diameter_in,
    hub_thickness=hub_thickness_in,
    no_of_spokes=no_of_spokes,
    spoke_radial_spacing_deg=spoke_radial_spacing_deg,
    spoke_thickness=spoke_thickness_in,
    spoke_width=spoke_width_in,
    spoke_radii=spoke_radii_in,
    hole_geometry_edge_count=hole_geometry_edge_count,
    hole_measurement=hole_diameter_measurement_in,
    hole_taper_length=hole_taper_length_in,
    hole_taper_angle_deg=hole_taper_angle_deg,
    fillet_radii=fillet_radii_in,
    mesh_tolerance_distance_in=mesh_tolerance_distance_in,
    file_path="C:\Users\soere\Google Drive\PROJECTS\NAVSEA Handwheel",
    file_name="handwheel",
    export_file=generate_files)  # -> handwheel_geometry, error_messages
panel = Panel(torque.error_messages)

# ==== cluster TORQUE
export_file = ClusterInput()
file_path = ClusterInput()
file_name = ClusterInput()
mesh_tolerance_distance_in = ClusterInput()
outer_race_diameter = ClusterInput()
outer_race_width = ClusterInput()
outer_race_thickness = ClusterInput()
inner_race_radius = ClusterInput()
no_of_finger_indentations = ClusterInput()
finger_indentation_radius = ClusterInput()
hub_diameter = ClusterInput()
hub_thickness = ClusterInput()
no_of_spokes = ClusterInput()
spoke_radial_spacing_deg = ClusterInput()
spoke_thickness = ClusterInput()
spoke_width = ClusterInput()
spoke_radii = ClusterInput()
hole_geometry_edge_count = ClusterInput()
hole_measurement = ClusterInput()
hole_taper_length = ClusterInput()
hole_taper_angle_deg = ClusterInput()
fillet_radii = ClusterInput()
concat = Concatenate(FragmentA="\", FragmentB=file_name)
rad = Radians(Degrees=hole_taper_angle_deg)
concat_2 = Concatenate(FragmentA=concat, FragmentB="_ASCII.stl")
concat_3 = Concatenate(FragmentA=concat, FragmentB="_binary.stl")
concat_4 = Concatenate(FragmentA=concat, FragmentB=".step")

# ---- group: Make Outer Race Outlines / make guide circles
division = Division(A=outer_race_diameter, B=2)
cir = Circle(Plane=PlaneXY(0, 0, 0), Radius=division)
subtraction = Subtraction(A=division, B=outer_race_width)
cir_2 = Circle(Plane=PlaneXY(0, 0, 0), Radius=subtraction)

# ---- group: Make Outer Race Outlines / make base crc
multiplication = Multiplication(A=no_of_finger_indentations, B=2)
divide = DivideCurve(Curve=cir, Count=multiplication, Kinks=False)  # -> Points, Tangents, Parameters
culln = CullNth(List=divide.Points, CullFrequency=2)
item = ListItem(List=culln, Index=0, Wrap=True)  # -> Item, Item1
cir_3 = Circle(Plane=[item.Item, item.Item1], Radius=finger_indentation_radius)
vec = Vector(unitize([item.Item, item.Item1]))
multiplication_2 = Multiplication(A=vec, B=finger_indentation_radius)
move = Move(Geometry=cir_3, Motion=expr("-x", multiplication_2))  # -> Geometry, Transform

# ---- group: Make radial spacing
rad_2 = Radians(Degrees=spoke_radial_spacing_deg)
expression = Expression(x=no_of_spokes, y=rad_2, Expression="if(y=0, 2*Pi/x, y)")

# ---- group: Inner race
cir_4 = Circle(Plane=PlaneXY(0, 0, 0), Radius=inner_race_radius)

# ---- group: Hole
division_2 = Division(A=hole_measurement, B=2)
polygon = Polygon(Plane=PlaneXY(0, 0, 0), Radius=division_2, Segments=hole_geometry_edge_count, FilletRadius=0)  # -> Polygon, Length

# ---- group: Make Outer Race Outlines / make arcs
item_2 = ListItem(List=move.Geometry, Index=0, Wrap=True)  # -> Item, Item1
tarc = TangentArcs(CircleA=item_2.Item, CircleB=item_2.Item1, Radius=finger_indentation_radius)  # -> ArcA, ArcB
xz = XZPlane(Origin=Point(0, 0, 0))
end = EndPoints(Curve=tarc.ArcA)  # -> Start, End
mirror = Mirror(Geometry=end.Start, Plane=xz)  # -> Geometry, Transform
flatten = FlattenTree(Tree=end.Start, Path="{0}")
flatten_2 = FlattenTree(Tree=mirror.Geometry, Path="{1}")
crv_cp = CurveClosestPoint(Point=[flatten, flatten_2], Curve=item_2.Item)  # -> Point, flatten(Parameter), Distance
shatter = Shatter(Curve=item_2.Item, Parameters=crv_cp.Parameter)
item_3 = ListItem(List=shatter, Index=1, Wrap=True)

# ---- group: Make Outer Race Outlines
expression_2 = Expression(x=no_of_finger_indentations, Expression="if(x=0, 1, 0)")
arrpolar = PolarArray(Geometry=flatten([tarc.ArcA, item_3]), Plane=PlaneXY(0, 0, 0), Count=no_of_finger_indentations, Angle=6.283185307)  # -> Geometry, Transform
join = JoinCurves(Curves=flatten(arrpolar.Geometry), Preserve=False)
merge = Merge(Data1=flatten(join), Data2=flatten(cir))
item_4 = ListItem(List=merge, Index=expression_2, Wrap=True)

# ---- group: Outer Race Diameter Dependencies
division_3 = Division(A=hub_diameter, B=2)
addition = Addition(A=division_3, B=outer_race_width)
division_4 = Division(A=outer_race_diameter, B=2)
larger = LargerThan(FirstNumber=division_4, SecondNumber=addition)  # -> LargerThan, OrEqualTo
panel = Panel(larger.LargerThan)
expression_3 = Expression(x=panel, Expression="if(x=\"True\", \"True\", \"Outer Race Diameter Error\")")

# ---- group: Inner Race Radius Dependencies
division_5 = Division(A=hole_measurement, B=2)
division_6 = Division(A=hub_diameter, B=2)
division_7 = Division(A=outer_race_diameter, B=2)
subtraction_2 = Subtraction(A=division_7, B=outer_race_width)
larger_2 = LargerThan(FirstNumber=inner_race_radius, SecondNumber=division_5)  # -> LargerThan, OrEqualTo
larger_3 = LargerThan(FirstNumber=inner_race_radius, SecondNumber=division_6)  # -> LargerThan, OrEqualTo
smaller = SmallerThan(FirstNumber=inner_race_radius, SecondNumber=subtraction_2)  # -> SmallerThan, OrEqualTo
panel_2 = Panel(larger_2.LargerThan)
panel_3 = Panel(larger_3.OrEqualTo)
and = GateAnd(A=larger_2.LargerThan, B=larger_3.OrEqualTo)
panel_4 = Panel(smaller.SmallerThan)
and_2 = GateAnd(A=and, B=smaller.SmallerThan)
panel_5 = Panel(and_2)
expression_4 = Expression(x=panel_5, Expression="if(x=\"True\", \"True\", \"Inner Race Radius Error\")")

# ---- group: No. of finger indentations
expression_5 = Expression(x=outer_race_diameter, Expression="x*Pi")
multiplication_3 = Multiplication(A=finger_indentation_radius, B=4)
division_8 = Division(A=expression_5, B=no_of_finger_indentations)
equals = Equality(FirstNumber=no_of_finger_indentations, SecondNumber=0)  # -> Equality, Inequality
smaller_2 = SmallerThan(FirstNumber=division_8, SecondNumber=multiplication_3)  # -> SmallerThan, OrEqualTo
panel_6 = Panel(equals.Equality)
panel_7 = Panel(smaller_2.SmallerThan)
or = GateOr(A=equals.Equality, B=smaller_2.SmallerThan)
panel_8 = Panel(or)
expression_6 = Expression(x=panel_8, Expression="if(x=\"True\", \"True\", \"No. of Finger Indentations Error\")")

# ---- group: Outer Race Width Dependencies
larger_4 = LargerThan(FirstNumber=outer_race_width, SecondNumber=0)  # -> LargerThan, OrEqualTo
panel_9 = Panel(larger_4.LargerThan)
expression_7 = Expression(x=panel_9, Expression="if(x=\"True\", \"True\", \"Outer Race Width Error\")")

# ---- group: Hub thickness
subtraction_3 = Subtraction(A=hole_taper_length, B=spoke_thickness)
larger_5 = LargerThan(FirstNumber=hub_thickness, SecondNumber=subtraction_3)  # -> LargerThan, OrEqualTo
panel_10 = Panel(larger_5.LargerThan)
expression_8 = Expression(x=panel_10, Expression="if(x=\"True\", \"True\", \"Hub Thickness Error\")")

# ---- group: HUB diameter
larger_6 = LargerThan(FirstNumber=hub_diameter, SecondNumber=hole_measurement)  # -> LargerThan, OrEqualTo
smaller_3 = SmallerThan(FirstNumber=hub_diameter, SecondNumber=expr("2*x", inner_race_radius))  # -> SmallerThan, OrEqualTo
panel_11 = Panel(smaller_3.OrEqualTo)
panel_12 = Panel(larger_6.LargerThan)
and_3 = GateAnd(A=larger_6.LargerThan, B=smaller_3.OrEqualTo)
panel_13 = Panel(and_3)
expression_9 = Expression(x=panel_13, Expression="if(x=\"True\", \"True\", \"Hub Diameter Error\")")

# ---- group: Outer Race Thickness Dependencies
expression_10 = Expression(x=outer_race_thickness, y=spoke_thickness, Expression="if(x≥y, True, False)")
panel_14 = Panel(expression_10)
expression_11 = Expression(x=panel_14, Expression="if(x=\"True\", \"True\", \"Outer Race Thickness Error\")")

# ---- group: Finger radius
item_5 = ListItem(List=tarc.ArcA, Index=0, Wrap=True)
geo = Geometry(cir_2)
crvprox = CurveProximity(CurveA=item_5, CurveB=geo)  # -> PointA, PointB, Distance
equals_2 = Equality(FirstNumber=finger_indentation_radius, SecondNumber=0)  # -> Equality, Inequality
larger_7 = LargerThan(FirstNumber=crvprox.Distance, SecondNumber=0)  # -> LargerThan, OrEqualTo
nullrep = ReplaceNulls(Items=larger_7.LargerThan, Replacements="True")  # -> Items, Count
or_2 = GateOr(A=nullrep.Items, B=equals_2.Equality)
panel_15 = Panel(or_2)
expression_12 = Expression(x=panel_15, Expression="if(x=\"True\", \"True\", \"Finger Radius Error\")")

# ---- group: Spoke thickness
addition_2 = Addition(A=spoke_thickness, B=hub_thickness)
smaller_4 = SmallerThan(FirstNumber=spoke_thickness, SecondNumber=outer_race_thickness)  # -> SmallerThan, OrEqualTo
larger_8 = LargerThan(FirstNumber=spoke_thickness, SecondNumber=0)  # -> LargerThan, OrEqualTo
larger_9 = LargerThan(FirstNumber=addition_2, SecondNumber=hole_taper_length)  # -> LargerThan, OrEqualTo
panel_16 = Panel(larger_8.LargerThan)
panel_17 = Panel(smaller_4.OrEqualTo)
panel_18 = Panel(larger_9.OrEqualTo)
and_4 = GateAnd(A=panel_18, B=panel_16)
and_5 = GateAnd(A=and_4, B=panel_17)
panel_19 = Panel(and_5)
expression_13 = Expression(x=panel_19, Expression="if(x=\"True\", \"True\", \"Spoke Thickness Error\")")

# ---- group: Make top hole
expression_14 = Expression(a=hole_taper_length, x=rad, Expression="a*(sin(x)/cos(x))")
division_9 = Division(A=hole_measurement, B=2)
expression_15 = Expression(a=division_9, b=expression_14, Expression="(a+b)/(a)")
scale_factor = Number(expression_15)
scale = Scale(Geometry=polygon.Polygon, Center=Point(0, 0, 0), Factor=expression_15)  # -> Geometry, Transform

# ---- group: Fillet radii
scale_factor_2 = Number(expression_15)
multiplication_4 = Multiplication(A=fillet_radii, B=2)
multiplication_5 = Multiplication(A=hole_measurement, B=scale_factor_2)
division_10 = Division(A=outer_race_width, B=2)
division_11 = Division(A=multiplication_5, B=2)
smaller_5 = SmallerThan(FirstNumber=multiplication_4, SecondNumber=spoke_width)  # -> SmallerThan, OrEqualTo
smaller_6 = SmallerThan(FirstNumber=fillet_radii, SecondNumber=division_10)  # -> SmallerThan, OrEqualTo
subtraction_4 = Subtraction(A=inner_race_radius, B=division_11)
panel_20 = Panel(smaller_5.SmallerThan)
smaller_7 = SmallerThan(FirstNumber=fillet_radii, SecondNumber=subtraction_4)  # -> SmallerThan, OrEqualTo
panel_21 = Panel(smaller_6.SmallerThan)
panel_22 = Panel(smaller_7.SmallerThan)
and_6 = GateAnd(A=panel_20, B=panel_22)
and_7 = GateAnd(A=and_6, B=panel_21)
panel_23 = Panel(and_7)
expression_16 = Expression(x=panel_23, Expression="Contains(x, \"False\")")
not = GateNot(A=expression_16)
panel_24 = Panel(not)
expression_17 = Expression(x=panel_24, Expression="if(x=\"True\", \"True\", \"Fillet Radii Error\")")

# ---- group: Hole measurement
scale_factor_3 = Number(expression_15)
multiplication_6 = Multiplication(A=hole_measurement, B=scale_factor_3)
smaller_8 = SmallerThan(FirstNumber=hole_measurement, SecondNumber=hub_diameter)  # -> SmallerThan, OrEqualTo
smaller_9 = SmallerThan(FirstNumber=multiplication_6, SecondNumber=expr("x*2", inner_race_radius))  # -> SmallerThan, OrEqualTo
panel_25 = Panel(smaller_8.SmallerThan)
panel_26 = Panel(smaller_9.SmallerThan)
and_8 = GateAnd(A=panel_26, B=panel_25)
panel_27 = Panel(and_8)
expression_18 = Expression(x=panel_27, Expression="if(x=\"True\", \"True\", \"Hole Measurement Error\")")

# ---- group: Hole Taper
panel_28 = Panel(and_8)
panel_29 = Panel(larger_9.OrEqualTo)
and_9 = GateAnd(A=panel_28, B=panel_29)
panel_30 = Panel(and_9)
expression_19 = Expression(x=panel_30, Expression="if(x=\"True\", \"True\", \"Hole Taper Angle Error\")")

# ---- group: Create spoke lines
division_12 = Division(A=spoke_width, B=2)
merge_2 = Merge(Data1=subtraction, Data2=inner_race_radius)
expression_20 = Expression(c=merge_2, b=division_12, Expression="sqrt(c^2-b^2)")  # -> graft(R)
multiplication_7 = Multiplication(A=division_12, B=-1)
merge_3 = Merge(Data1=division_12, Data2=multiplication_7)
pt = ConstructPoint(XCoordinate=expression_20, YCoordinate=merge_3, ZCoordinate=0)
bang = ExplodeTree(Data=pt)  # -> Branch0, Branch1
item_6 = ListItem(List=bang.Branch0, Index=0, Wrap=True)  # -> Item, Item1
item_7 = ListItem(List=bang.Branch1, Index=0, Wrap=True)  # -> Item, Item1
ln = Line(StartPoint=item_6.Item1, EndPoint=item_7.Item1)
ln_2 = Line(StartPoint=item_6.Item, EndPoint=item_7.Item)

# ---- group: No. of spokes
pdecon = Deconstruct(Point=item_7.Item)  # -> XComponent, YComponent, ZComponent
division_13 = Division(A=pdecon.YComponent, B=inner_race_radius)
asin = ArcSine(Value=division_13)
subtraction_5 = Subtraction(A=no_of_spokes, B=1)
pi = Pi(Factor=1)
multiplication_8 = Multiplication(A=asin, B=2)
multiplication_9 = Multiplication(A=pi, B=2)
multiplication_10 = Multiplication(A=subtraction_5, B=expression)
subtraction_6 = Subtraction(A=multiplication_9, B=multiplication_8)
smaller_10 = SmallerThan(FirstNumber=multiplication_10, SecondNumber=subtraction_6)  # -> SmallerThan, OrEqualTo
panel_31 = Panel(smaller_10.SmallerThan)
expression_21 = Expression(x=panel_31, Expression="if(x=\"True\", \"True\", \"No. of Spokes Error\")")

# ---- group: array spoke lines
series = Series(Start=0, Step=expression, Count=no_of_spokes)  # -> graft(Series)
merge_4 = Merge(Data1=ln_2, Data2=ln)
rotate = Rotate(Geometry=merge_4, Angle=series, Plane=PlaneXY(0, 0, 0))  # -> Geometry, Transform

# ---- group: construct arc remainder
merge_5 = Merge(Data1=flatten(item_7.Item), Data2=simplify(item_6.Item))  # -> flatten(Result)
expression_22 = Expression(x=expression, y=no_of_spokes, Expression="x*(y-1)")
lng = ListLength(List=merge_5)
dup = DuplicateData(Data=expression_22, Number=lng, Order=True)
rotate_2 = Rotate(Geometry=merge_5, Angle=dup, Plane=PlaneXY(0, 0, 0))  # -> Geometry, Transform
expression_23 = Expression(x=spoke_width, y=expression_22, z=[inner_race_radius, subtraction], Expression="(2*Pi)-(y+2*Asin(x/(2*z)))")
rotate_3 = Rotate(Geometry=rotate_2.Geometry, Angle="Pi/2", Plane=PlaneXY(0, 0, 0))  # -> Geometry, Transform
pl = ConstructPlane(Origin=Point(0, 0, 0), XAxis=rotate_2.Geometry, YAxis=rotate_3.Geometry)
arc = Arc(Plane=pl, Radius=[inner_race_radius, subtraction], Angle=expression_23)  # -> Arc, Length

# ---- group: generate base arc
expression_24 = Expression(x=inner_race_radius, y=spoke_width, z=expression, Expression="z-2*(Asin(y/(2*x)))")
expression_25 = Expression(x=subtraction, y=spoke_width, z=expression, Expression="z-2*(Asin(y/(2*x)))")
pl_2 = ConstructPlane(Origin=Point(0, 0, 0), XAxis=item_6.Item, YAxis=Vector(0, 1, 0))
pl_3 = ConstructPlane(Origin=Point(0, 0, 0), XAxis=item_7.Item, YAxis=Vector(0, 1, 0))
arc_2 = Arc(Plane=pl_2, Radius=subtraction, Angle=expression_25)  # -> Arc, Length
arc_3 = Arc(Plane=pl_3, Radius=inner_race_radius, Angle=expression_24)  # -> Arc, Length

# ---- group: Spoke radial spacing
inner_arc_angle = Number(expression_24)
larger_10 = LargerThan(FirstNumber=inner_arc_angle, SecondNumber=0)  # -> LargerThan, OrEqualTo
and_10 = GateAnd(A=smaller_10.SmallerThan, B=larger_10.OrEqualTo)
panel_32 = Panel(and_10)
expression_26 = Expression(x=panel_32, Expression="if(x=\"True\", \"True\", \"Spoke Radial Spacing Error\")")

# ---- group: Spoke width
inner_arc_angle_2 = Number(expression_24)
larger_11 = LargerThan(FirstNumber=inner_arc_angle_2, SecondNumber=0)  # -> LargerThan, OrEqualTo
larger_12 = LargerThan(FirstNumber=spoke_width, SecondNumber=0)  # -> LargerThan, OrEqualTo
panel_33 = Panel(larger_11.OrEqualTo)
panel_34 = Panel(larger_12.LargerThan)
and_11 = GateAnd(A=panel_33, B=panel_34)
panel_35 = Panel(and_11)
expression_27 = Expression(x=panel_35, Expression="if(x=\"True\", \"True\", \"Spoke Width Error\")")

# ---- group: Array base arcs
expression_28 = Expression(x=no_of_spokes, Expression="if(x=1, 1, x-1)")
merge_6 = Merge(Data1=arc_3.Arc, Data2=arc_2.Arc)  # -> flatten(Result)
series_2 = Series(Start=0, Step=expression, Count=expression_28)  # -> graft(Series)
rotate_4 = Rotate(Geometry=merge_6, Angle=series_2, Plane=PlaneXY(0, 0, 0))  # -> Geometry, Transform
ma = MassAddition(Input=series_2)  # -> Result, PartialResults

# ---- group: Spoke layout
flatten_3 = FlattenTree(Tree=arc.Arc, Path="{0}")
flatten_4 = FlattenTree(Tree=rotate_4.Geometry, Path="{1}")
flatten_5 = FlattenTree(Tree=flatten_3, Path="{1}")
merge_7 = Merge(Data1=flatten_3, Data2=flatten_4, Data3=flatten_5)
expression_29 = Expression(x=no_of_spokes, Expression="if(x=1, 0, 1)")
tstat = TreeStatistics(Tree=merge_7)  # -> Paths, Length, Count
item_8 = ListItem(List=tstat.Paths, Index=expression_29, Wrap=True)
branch = TreeBranch(Tree=merge_7, Path=item_8, MaintainPaths=True)
join_2 = JoinCurves(Curves=flatten([rotate.Geometry, branch]), Preserve=False)

# ---- group: make spoke closing arc
division_14 = Division(A=spoke_width, B=2)
division_15 = Division(A=division_14, B=subtraction)
pl_4 = ConstructPlane(Origin=Point(0, 0, 0), XAxis=item_6.Item1, YAxis=Vector(0, 1, 0))
asin_2 = ArcSine(Value=division_15)
multiplication_11 = Multiplication(A=asin_2, B=2)
arc_4 = Arc(Plane=pl_4, Radius=subtraction, Angle=multiplication_11)  # -> Arc, Length
series_3 = Series(Start=0, Step=expression, Count=no_of_spokes)
rotate_5 = Rotate(Geometry=arc_4.Arc, Angle=series_3, Plane=PlaneXY(0, 0, 0))  # -> Geometry, Transform

# ---- group: Extrude Outer Race Wall
Z = UnitZ(Factor=outer_race_thickness)
extr = Extrude(Base=item_4, Direction=expr("-x", Z))

# ---- group: Make Hub Wall and Defining circle
cir_5 = Circle(Plane=PlaneXY(0, 0, 0), Radius=expr("x/2", hub_diameter))
Z_2 = UnitZ(Factor=spoke_thickness)
Z_3 = UnitZ(Factor=hub_thickness)
move_2 = Move(Geometry=cir_5, Motion=expr("-x", Z_2))  # -> Geometry, Transform
extr_2 = Extrude(Base=move_2.Geometry, Direction=expr("-x", Z_3))
move_3 = Move(Geometry=move_2.Geometry, Motion=expr("-x", Z_3))  # -> Geometry, Transform

# ---- group: Make Inner Wall Outer Race
Z_4 = UnitZ(Factor=outer_race_thickness)
subtraction_7 = Subtraction(A=outer_race_thickness, B=spoke_thickness)
Z_5 = UnitZ(Factor=subtraction_7)
move_4 = Move(Geometry=cir_2, Motion=expr("-x", Z_4))  # -> Geometry, Transform
extr_3 = Extrude(Base=move_4.Geometry, Direction=Z_5)

# ---- group: Make Outer Race Bottom Surface
boundary = BoundarySurfaces(Edges=flatten([item_4, cir_2]))
Z_6 = UnitZ(Factor=outer_race_thickness)
move_5 = Move(Geometry=boundary, Motion=expr("-x", Z_6))  # -> Geometry, Transform
move_6 = Move(Geometry=[item_4, cir_2], Motion=expr("-x", Z_6))  # -> Geometry, Transform

# ---- group: Make Spoke Wall
Z_7 = UnitZ(Factor=spoke_thickness)
extr_4 = Extrude(Base=join_2, Direction=expr("-x", Z_7))

# ---- group: Make Top Surface
boundary_2 = BoundarySurfaces(Edges=flatten([join_2, scale.Geometry, item_4]))

# ---- group: make spoke fillet guide pts
debrep = DeconstructBrep(Brep=extr_4)  # -> Faces, Edges, Vertices
division_16 = Division(A=spoke_thickness, B=2)
midpt = CurveMiddle(Curve=debrep.Edges)
pdecon_2 = Deconstruct(Point=midpt)  # -> XComponent, YComponent, ZComponent
equals_3 = Equality(FirstNumber=pdecon_2.ZComponent, SecondNumber=expr("-x", division_16))  # -> Equality, Inequality
cull = CullPattern(List=midpt, CullPattern=equals_3.Equality)

# ---- group: Make Bottom Spoke Outline and SRF
item_9 = ListItem(List=rotate_4.Geometry, Index=1, Wrap=True)
item_10 = ListItem(List=arc.Arc, Index=0, Wrap=True)  # -> flatten(Item)
flatten_6 = FlattenTree(Tree=item_9, Path="{1}")
flatten_7 = FlattenTree(Tree=item_10, Path="{1}")
Z_8 = UnitZ(Factor=spoke_thickness)
merge_8 = Merge(Data1=item_10, Data2=flatten_7, Data3=flatten_6)
expression_30 = Expression(x=no_of_spokes, Expression="if(x=1, 0, 1)")
tstat_2 = TreeStatistics(Tree=merge_8)  # -> Paths, Length, Count
item_11 = ListItem(List=tstat_2.Paths, Index=expression_30, Wrap=True)
branch_2 = TreeBranch(Tree=merge_8, Path=item_11, MaintainPaths=True)
join_3 = JoinCurves(Curves=flatten([branch_2, rotate.Geometry, rotate_5.Geometry]), Preserve=False)
move_7 = Move(Geometry=join_3, Motion=expr("-x", Z_8))  # -> Geometry, Transform
move_8 = Move(Geometry=rotate_5.Geometry, Motion=expr("-x", Z_8))  # -> Geometry, Transform

# ----
boundary_3 = BoundarySurfaces(Edges=flatten([move_2.Geometry, move_7.Geometry]))

# ---- group: Find fillet guide pts
Z_9 = UnitZ(Factor=outer_race_thickness)
join_4 = JoinCurves(Curves=[join_2, item_4], Preserve=False)
fillet = Fillet(Curve=join_4, Radius=spoke_radii)
move_9 = Move(Geometry=fillet, Motion=expr("-x", Z_9))  # -> Geometry, Transform
join_5 = JoinCurves(Curves=move_6.Geometry, Preserve=False)
join_6 = JoinCurves(Curves=move_9.Geometry, Preserve=False)
group = Group(Objects=join_6)
group_2 = Group(Objects=join_5)
flatten_8 = FlattenTree(Tree=group_2, Path="{0}")
flatten_9 = FlattenTree(Tree=group, Path="{1}")
expression_31 = Expression(x=outer_race_thickness, y=spoke_thickness, Expression="if(x=y, 1, 0)")
merge_9 = Merge(Data1=flatten_8, Data2=flatten_9)  # -> flatten(Result)
item_12 = ListItem(List=merge_9, Index=expression_31, Wrap=True)
ungroup = Ungroup(Group=item_12)
cull_i = CullIndex(List=ungroup, Indices=0, Wrap=True)
explode = Explode(Curve=[cull_i, fillet], Recursive=True)  # -> Segments, Vertices
explode_2 = Explode(Curve=[fillet, ungroup], Recursive=True)  # -> Segments, Vertices
item_13 = ListItem(List=ungroup, Index=0, Wrap=True)
midpt_2 = CurveMiddle(Curve=flatten([explode.Segments, item_13]))  # -> flatten(Midpoint)
midpt_3 = CurveMiddle(Curve=flatten(explode_2.Segments))  # -> flatten(Midpoint)
group_3 = Group(Objects=midpt_2)
group_4 = Group(Objects=midpt_3)
flatten_10 = FlattenTree(Tree=group_3, Path="{1}")
flatten_11 = FlattenTree(Tree=group_4, Path="{0}")
merge_10 = Merge(Data1=flatten_11, Data2=flatten_10)  # -> flatten(Result)
item_14 = ListItem(List=merge_10, Index=expression_31, Wrap=True)
ungroup_2 = Ungroup(Group=item_14)

# ---- group: Make hub bottom srf and opening
addition_3 = Addition(A=hub_thickness, B=spoke_thickness)
Z_10 = UnitZ(Factor=addition_3)
move_10 = Move(Geometry=polygon.Polygon, Motion=expr("-x", Z_10))  # -> Geometry, Transform
boundary_4 = BoundarySurfaces(Edges=flatten([move_10.Geometry, move_3.Geometry]))

# ---- group: Make hole inner wall
addition_4 = Addition(A=hub_thickness, B=spoke_thickness)
subtraction_8 = Subtraction(A=addition_4, B=hole_taper_length)
Z_11 = UnitZ(Factor=subtraction_8)
move_11 = Move(Geometry=move_10.Geometry, Motion=Z_11)  # -> Geometry, Transform
extr_5 = Extrude(Base=move_10.Geometry, Direction=Z_11)
loft = Loft(
    Curves=[move_11.Geometry, scale.Geometry],
    Options={Adjust=False, Closed=False, LoftEnds=0, LoftSimp=0, LoftType=0, Rebuild=10, Refit=0.01})

# ---- group: join all surfaces
join_7 = BrepJoin(Breps=flatten([extr_4, boundary_2, move_5.Geometry, extr_3, extr, extr_2, boundary_3, boundary_4, loft, extr_5]))  # -> Breps, Closed

# ----
fmerge = MergeFaces(Brep=join_7.Breps)  # -> Breps, Before, After

# ---- group: Spoke Fillet
flatten_12 = FlattenTree(Tree=cull, Path="{0}")
debrep_2 = DeconstructBrep(Brep=fmerge.Breps)  # -> Faces, Edges, Vertices
midpt_4 = CurveMiddle(Curve=debrep_2.Edges)
cp = ClosestPoint(Point=graft(flatten_12), Cloud=midpt_4)  # -> ClosestPoint, flatten(CPIndex), Distance
filedge = FilletEdge(Shape=fmerge.Breps, Blend=0, Metric=0, Edges=cp.CPIndex, Radii=spoke_radii)
cap = CapHoles(Brep=filedge)
fmerge_2 = MergeFaces(Brep=cap)  # -> Breps, Before, After

# ---- group: Spoke Radius
handwheel_with_spoke_fillet = Geometry(fmerge_2.Breps)
panel_36 = Panel(handwheel_with_spoke_fillet)
expression_32 = Expression(x=panel_36, Expression="Contains(x, \"Invalid\")")
expression_33 = Expression(x=panel_36, Expression="Contains(x, \"Open\")")
smaller_11 = SmallerThan(FirstNumber=spoke_radii, SecondNumber=inner_race_radius)  # -> SmallerThan, OrEqualTo
not_2 = GateNot(A=expression_33)
not_3 = GateNot(A=expression_32)
and_12 = GateAnd(A=not_2, B=not_3)
and_13 = GateAnd(A=and_12, B=smaller_11.SmallerThan)
panel_37 = Panel(and_13)
expression_34 = Expression(x=panel_37, Expression="if(x=\"True\", \"True\", \"Spoke Radius Error\")")

# ----
merge_11 = Merge(
    Data1=expression_3,
    Data2=expression_7,
    Data3=expression_11,
    Data4=expression_4,
    Data5=expression_6,
    Data6=expression_12,
    Data7=expression_9,
    Data8=expression_8,
    Data9=expression_21,
    Data10=expression_26,
    Data11=expression_13,
    Data12=expression_27,
    Data13=expression_34,
    Data14=expression_18,
    Data15=expression_19,
    Data16=expression_17)  # -> flatten(Result)
expression_35 = Expression(x=merge_11, Expression="if(x=\"True\", \"True\", \"False\")")
cull_2 = CullPattern(List=merge_11, CullPattern=invert(expression_35))
merge_12 = Merge(Data1="No Errors", Data2=cull_2)
panel_38 = Panel(spoke_radii)

# ---- group: get final mid pts
debrep_3 = DeconstructBrep(Brep=fmerge_2.Breps)  # -> Faces, Edges, Vertices
midpt_5 = CurveMiddle(Curve=debrep_3.Edges)  # -> flatten(Midpoint)

# ----
cp_2 = ClosestPoint(Point=graft(ungroup_2), Cloud=flatten(midpt_5))  # -> ClosestPoint, flatten(CPIndex), Distance
cset = CreateSet(List=cp_2.CPIndex)  # -> Set, Map
filedge_2 = FilletEdge(Shape=fmerge_2.Breps, Blend=0, Metric=0, Edges=cset.Set, Radii=fillet_radii)
py_bake = PythonScript(
    geo=filedge_2,
    active=export_file,
    dir=file_path,
    filenamea=concat_2,
    filenameb=concat_3,
    filenames=concat_4,
    u=mesh_tolerance_distance_in)  # -> out, a
# ---------- py_bake: Python ----------
import rhinoscriptsyntax as rs
import scriptcontext
import Rhino
import os

namea = filenamea
savenamea = dir + namea
print savenamea

nameb = filenameb
savenameb = dir + nameb
print savenameb

names = filenames
savenames = dir + names
print savenames


if active:
    
    #we create or use some geometry
    geo_id = geo # or rs.AddLine((0,1,2), (9,8,7))
    #(we could do all operations here...
    
    scriptcontext.doc = ghdoc
    #we obtain the reference in the Rhino doc
    doc_object = rs.coercerhinoobject(geo_id)
    print(type(doc_object))
    
    attributes = doc_object.Attributes
    print('the type of attributes is: ' + str(type(attributes)))
    geometry = doc_object.Geometry
    print('the type of geometry is: ' + str(type(geometry)))
    
    #we change the scriptcontext
    scriptcontext.doc = Rhino.RhinoDoc.ActiveDoc
    
    #we add both the geometry and the attributes to the Rhino doc
    rhino_geo = scriptcontext.doc.Objects.Add(geometry, attributes)
    print('the Rhino doc ID is: ' + str(rhino_geo))
    
    #we put back the original Grasshopper document as default
    scriptcontext.doc = ghdoc
    
    
    
    
    
    rs.Command("_SelAll")
    rs.Command("-_Export\n\"" + savenamea + "\"\n _ExportFileAs=ASCII _UseSimpleDialog=No _Enter _d _a _Angle=25 _AspectRatio=5 _Distance=" + str(u) + " _Density=0 _Grid=0 MaxEdgeLength=0 _Enter _Enter _Enter")
    
    rs.Command("_SelAll")
    rs.Command("-_Export\n\"" + savenameb + "\"\n _ExportFileAs=Binary _UseSimpleDialog=No _Enter _d _a _Angle=25 _AspectRatio=5 _Distance=" + str(u) + " _Density=0 _Grid=0 MaxEdgeLength=0 _Enter _Enter _Enter")
    
    rs.Command("_SelAll")
    rs.Command("-_Export\n\"" + savenames + "\"\n  _SplitClosedSurfaces=No _Enter _Enter")
    
    rs.Command("_SelAll")
    rs.Command("-_Delete")
    
    
    #rs.Command("-_Export " + filename + " _UseSimpleParameters=No _Enter _Angle=25 _AspectRatio=5 _Distance=0.001 _e _Grid=0 MaxEdgeLength=0 _Enter")
    
    #rs.Command("-_Export\n\"" + savename + "\"\n _Enter\n _DetailedOptions\n _A\n _e\n\n 0.5\"\n _Enter\n _Enter\n _Enter")
# ---------- end py_bake ----------
handwheel_geometry = ClusterOutput(filedge_2)
error_messages = ClusterOutput(merge_12)
